# Grasshopper definition signal_strength.gh (Grasshopper 0.9.70)
# Copyright: 2013

brep = Brep([<brep referenced from the Rhino model> x17])
pt = Point(<point referenced from the Rhino model>)
volume = Volume(Geometry=brep)  # -> Volume, Centroid
dist = Distance(PointA=volume.Centroid, PointB=pt)
bnd = Bounds(Numbers=dist)
remap = RemapNumbers(Value=dist, Source=bnd, Target=Domain(0, 1))  # -> Mapped, Clipped
subtraction = Subtraction(A=1, B=remap.Clipped)
frgb = ColourRGBF(Alpha=1, Red=subtraction, Green=0, Blue=remap.Mapped)
preview = CustomPreview(Geometry=brep, Shader=frgb)
dots = DotDisplay(Point=volume.Centroid, Colour=frgb, Size=Slider(10, range=0..10))
